# Grasshopper definition PanamaLaVieja.gh (Grasshopper 1.0.7)
# plug-ins: GHopperGIS

# ---- group: Input the file location
panel = Panel("C:\Users\Paula\Desktop\Felipe\Panama\Vieja.gpkg")

# ---- group: Construcciones / Field!
number_slider = Slider(24, range=0..24)  # disabled

# ---- group: WorldCenter
pt = ConstructPoint(XCoordinate=0, YCoordinate=0, ZCoordinate=0)

# ---- group: ScaleFactor
number_slider_2 = Slider(1000, range=0..1000)

# ---- group: Terreno
panel_2 = Panel("C:\Users\Paula\Desktop\Felipe\Panama\Terreno\Terreno.tif")
readgribfiles = ReadGribFileInfo(PathToFile=panel_2)  # -> CatchErrors, DataSet
getgribfilecoordinates = GetCoordinateFromGribFile(PathToFile=panel_2)  # -> CatchErrors, Latitude, Longitude
proj = Projections(Latitude=getgribfilecoordinates.Latitude, Longitude=getgribfilecoordinates.Longitude)  # -> ProjectedPoints, Erros
Z = UnitZ(Factor=readgribfiles.DataSet)

# ---- group: AreasProtegidas
panel_3 = Panel("C:\Users\Paula\Desktop\Felipe\Panama\AreasProtegidas\AreasProtegidasReProjected.shp")
gisext = GISExtents(PathToFile=panel_3)  # -> CatchErrors, MinimumX, MinimumY, MaximumX, MaximumY
rdgis = ReadGIS(PathToFile=panel_3)  # -> CatchErrors, LatitudeOfGeometry, LongitudeOfGeometry, AltitudeOfGeometry, CullPattern
proj_2 = Projections(Latitude=rdgis.LatitudeOfGeometry, Longitude=rdgis.LongitudeOfGeometry)  # -> ProjectedPoints, Erros

# ---- group: Edificios
panel_4 = Panel("C:\Users\Paula\Desktop\Felipe\Panama\Edificios\EdificiosClipped.shp")
number_slider_3 = Slider(0, range=0..1)
gisextr = GISExtractor(PathToFile=panel_4, FieldToSelect=Slider(14, range=0..20), LayerToSelect=number_slider_3)  # -> CatchErrors, NumberOfFeatures, Layers, Fields, OutputField, GeometryType
gisext_2 = GISExtents(PathToFile=panel_4, LayerToSelect=number_slider_3)  # -> CatchErrors, MinimumX, MinimumY, MaximumX, MaximumY
rdgis_2 = ReadGIS(PathToFile=panel_4, ParallelComputation=Toggle(False), LayerToSelect=number_slider_3)  # -> CatchErrors, LatitudeOfGeometry, LongitudeOfGeometry, AltitudeOfGeometry, CullPattern
proj_3 = Projections(Latitude=gisext_2.MinimumX, Longitude=gisext_2.MinimumY)  # -> ProjectedPoints, Erros
proj_4 = Projections(Latitude=gisext_2.MaximumX, Longitude=gisext_2.MaximumY)  # -> ProjectedPoints, Erros
proj_5 = Projections(Latitude=rdgis_2.LatitudeOfGeometry, Longitude=rdgis_2.LongitudeOfGeometry)  # -> ProjectedPoints, Erros
rec_2pt = Rectangle2Pt(Plane=PlaneXY(0, 0, 0), PointA=proj_3.ProjectedPoints, PointB=proj_4.ProjectedPoints, Radius=0)  # -> Rectangle, Length
area = Area(Geometry=rec_2pt.Rectangle)  # -> Area, Centroid
vec2pt = Vector2Pt(PointA=area.Centroid, PointB=pt, Unitize=False)  # -> Vector, Length
move = Move(Geometry=proj_5.ProjectedPoints, Motion=vec2pt.Vector)  # -> Geometry, Transform
number_slider_4 = Slider(10, range=0..10)
scale = Scale(Geometry=move.Geometry, Center=pt, Factor=number_slider_2)  # -> Geometry, Transform
pline = PolyLine(Vertices=scale.Geometry, Closed=False)
area_2 = Area(Geometry=pline, UseTasks=True)  # -> Area, Centroid
pdecon = Deconstruct(Point=area_2.Centroid)  # -> XComponent, YComponent, ZComponent
multiplication = Multiplication(A=gisextr.OutputField, B=Slider(3, range=0..10))
Z_2 = UnitZ(Factor=multiplication)

# ----
panel_5 = Panel(gisextr.OutputField)
panel_6 = Panel(gisextr.Fields)

# ---- group: Rutas
panel_7 = Panel("C:\Users\Paula\Desktop\Felipe\Panama\RutasTransporte\RutasClipped.shp")
rdgis_3 = ReadGIS(PathToFile=panel_7, ParallelComputation=Toggle(False), LayerToSelect=Slider(0, range=0..5))  # -> CatchErrors, LatitudeOfGeometry, LongitudeOfGeometry, AltitudeOfGeometry, CullPattern
proj_6 = Projections(Latitude=rdgis_3.LatitudeOfGeometry, Longitude=rdgis_3.LongitudeOfGeometry)  # -> ProjectedPoints, Erros
vec2pt_2 = Vector2Pt(PointA=area.Centroid, PointB=pt, Unitize=False)  # -> Vector, Length
move_2 = Move(Geometry=proj_6.ProjectedPoints, Motion=vec2pt_2.Vector)  # -> Geometry, Transform
scale_2 = Scale(Geometry=move_2.Geometry, Center=pt, Factor=number_slider_2)  # -> Geometry, Transform
pline_2 = PolyLine(Vertices=scale_2.Geometry, Closed=False)

# ---- group: Normativa
panel_8 = Panel("C:\Users\Paula\Desktop\Felipe\Panama\Normativa\NormativaClipped.shp")
gisextr_2 = GISExtractor(PathToFile=panel_8, FieldToSelect=Slider(5, range=0..7))  # -> CatchErrors, NumberOfFeatures, Layers, Fields, OutputField, GeometryType
rdgis_4 = ReadGIS(PathToFile=panel_8)  # -> CatchErrors, LatitudeOfGeometry, LongitudeOfGeometry, AltitudeOfGeometry, CullPattern
proj_7 = Projections(Latitude=rdgis_4.LatitudeOfGeometry, Longitude=rdgis_4.LongitudeOfGeometry)  # -> ProjectedPoints, Erros
panel_9 = Panel(gisextr_2.OutputField)
vec2pt_3 = Vector2Pt(PointA=area.Centroid, PointB=pt, Unitize=False)  # -> Vector, Length
move_3 = Move(Geometry=proj_7.ProjectedPoints, Motion=vec2pt_3.Vector)  # -> Geometry, Transform
scale_3 = Scale(Geometry=move_3.Geometry, Center=pt, Factor=number_slider_2)  # -> Geometry, Transform
pline_3 = PolyLine(Vertices=scale_3.Geometry, Closed=False)

# ---- group: Terreno (continued)
move_4 = Move(Geometry=proj.ProjectedPoints, Motion=vec2pt_3.Vector)  # -> Geometry, Transform
scale_4 = Scale(Geometry=move_4.Geometry, Center=pt, Factor=number_slider_2)  # -> Geometry, Transform
move_5 = Move(Geometry=scale_4.Geometry, Motion=Z)  # -> Geometry, Transform
lng = ListLength(List=move_5.Geometry)
sqrt = SquareRoot(Value=lng)
srfgrid = SurfaceFromPoints(Points=move_5.Geometry, UCount=sqrt, Interpolate=False)

# ---- group: Barrios
panel_10 = Panel("C:\Users\Paula\Desktop\Felipe\Panama\Barrios\BarriosClipped.shp")
gisextr_3 = GISExtractor(PathToFile=panel_10, FieldToSelect=Slider(10, range=0..15))  # -> CatchErrors, NumberOfFeatures, Layers, Fields, OutputField, GeometryType
rdgis_5 = ReadGIS(PathToFile=panel_10, ParallelComputation=Toggle(False))  # -> CatchErrors, LatitudeOfGeometry, LongitudeOfGeometry, AltitudeOfGeometry, CullPattern
panel_11 = Panel(gisextr_3.OutputField)
proj_8 = Projections(Latitude=rdgis_5.LatitudeOfGeometry, Longitude=rdgis_5.LongitudeOfGeometry)  # -> ProjectedPoints, Erros
vec2pt_4 = Vector2Pt(PointA=area.Centroid, PointB=pt, Unitize=False)  # -> Vector, Length
move_6 = Move(Geometry=proj_8.ProjectedPoints, Motion=vec2pt_4.Vector)  # -> Geometry, Transform
scale_5 = Scale(Geometry=move_6.Geometry, Center=pt, Factor=number_slider_2)  # -> Geometry, Transform
pline_4 = PolyLine(Vertices=scale_5.Geometry, Closed=False)
project = Project(Curve=pline_4, Brep=srfgrid, Direction=Vector(0, 0, 1))

# ---- group: Vías
number_slider_5 = Slider(1, range=0..1)
number_slider_6 = Slider(1, range=0..1)
rdgis_6 = ReadGIS(PathToFile=panel, LayerToSelect=number_slider_6)  # -> CatchErrors, LatitudeOfGeometry, LongitudeOfGeometry, AltitudeOfGeometry, CullPattern
proj_9 = Projections(Latitude=rdgis_6.LatitudeOfGeometry, Longitude=rdgis_6.LongitudeOfGeometry)  # -> ProjectedPoints, Erros
pline_5 = PolyLine(Vertices=proj_9.ProjectedPoints, Closed=False)
vec2pt_5 = Vector2Pt(PointA=area.Centroid, PointB=pt, Unitize=False)  # -> Vector, Length
move_7 = Move(Geometry=pline_5, Motion=vec2pt_5.Vector)  # -> Geometry, Transform
scale_6 = Scale(Geometry=move_7.Geometry, Center=pt, Factor=number_slider_2)  # -> Geometry, Transform
project_2 = Project(Curve=scale_6.Geometry, Brep=srfgrid, Direction=Vector(0, 0, 1))

# ---- group: Parques
panel_12 = Panel("C:\Users\Paula\Desktop\Felipe\Panama\Park\ParkClipped.shp")
number_slider_7 = Slider(0, range=0..1)
gisextr_4 = GISExtractor(PathToFile=panel_12, FieldToSelect=Slider(5, range=0..10), LayerToSelect=number_slider_7)  # -> CatchErrors, NumberOfFeatures, Layers, Fields, OutputField, GeometryType
gisext_3 = GISExtents(PathToFile=panel_12, LayerToSelect=number_slider_7)  # -> CatchErrors, MinimumX, MinimumY, MaximumX, MaximumY
rdgis_7 = ReadGIS(PathToFile=panel_12, ParallelComputation=Toggle(True), LayerToSelect=number_slider_7)  # -> CatchErrors, LatitudeOfGeometry, LongitudeOfGeometry, AltitudeOfGeometry, CullPattern
proj_10 = Projections(Latitude=gisext_3.MinimumX, Longitude=gisext_3.MinimumY)  # -> ProjectedPoints, Erros
proj_11 = Projections(Latitude=gisext_3.MaximumX, Longitude=gisext_3.MaximumY)  # -> ProjectedPoints, Erros
proj_12 = Projections(Latitude=rdgis_7.LatitudeOfGeometry, Longitude=rdgis_7.LongitudeOfGeometry)  # -> ProjectedPoints, Erros
rec_2pt_2 = Rectangle2Pt(Plane=PlaneXY(0, 0, 0), PointA=proj_10.ProjectedPoints, PointB=proj_11.ProjectedPoints, Radius=0)  # -> Rectangle, Length
area_3 = Area(Geometry=rec_2pt_2.Rectangle)  # -> Area, Centroid
vec2pt_6 = Vector2Pt(PointA=area.Centroid, PointB=pt, Unitize=False)  # -> Vector, Length
move_8 = Move(Geometry=proj_12.ProjectedPoints, Motion=vec2pt_6.Vector)  # -> Geometry, Transform
scale_7 = Scale(Geometry=move_8.Geometry, Center=pt, Factor=number_slider_2)  # -> Geometry, Transform
srf_cp = SurfaceClosestPoint(Point=scale_7.Geometry, Surface=srfgrid)  # -> Point, UVPoint, Distance
pdecon_2 = Deconstruct(Point=srf_cp.Point)  # -> XComponent, YComponent, ZComponent
pdecon_3 = Deconstruct(Point=scale_7.Geometry)  # -> XComponent, YComponent, ZComponent
pt_2 = ConstructPoint(XCoordinate=pdecon_3.XComponent, YCoordinate=pdecon_3.YComponent, ZCoordinate=pdecon_2.ZComponent)
tag = TextTag(Location=simplify(pt_2), Text=simplify(graft(gisextr_4.OutputField)))
dots = DotDisplay(Point=pt_2, Colour=RGB(0, 174, 0), Size=Slider(10, range=0..10))

# ---- group: Vías / ExtractInfo
gisextr_5 = GISExtractor(PathToFile=panel, FieldToSelect=number_slider_5, LayerToSelect=number_slider_6)  # -> CatchErrors, NumberOfFeatures, Layers, Fields, OutputField, GeometryType
panel_13 = Panel(gisextr_5.OutputField)

# ---- group: Vías / NombreVías
expression = Expression(x=gisextr_5.OutputField, Expression="If( ( x ≠ \"\" ) and ( x ≠ \"This feature is null!\" ), True, False )")
cull = CullPattern(List=flatten(project_2), CullPattern=expression)
cull_2 = CullPattern(List=gisextr_5.OutputField, CullPattern=expression)
eval = EvaluateCurve(Curve=reparameterize(cull), Parameter=0.5)  # -> Point, Tangent, Angle
tag_2 = TextTag(Location=eval.Point, Text=cull_2)

# ---- group: AreasProtegidas (continued)
move_9 = Move(Geometry=proj_2.ProjectedPoints, Motion=vec2pt_3.Vector)  # -> Geometry, Transform
scale_8 = Scale(Geometry=move_9.Geometry, Center=pt, Factor=number_slider_2)  # -> Geometry, Transform
pline_6 = PolyLine(Vertices=scale_8.Geometry, Closed=False)
project_3 = Project(Curve=pline_6, Brep=srfgrid, Direction=Vector(0, 0, 1))

# ---- group: Rutas (continued)
project_4 = Project(Curve=pline_2, Brep=srfgrid, Direction=Vector(0, 0, 1))

# ---- group: Normativa (continued)
project_5 = Project(Curve=pline_3, Brep=srfgrid, Direction=Vector(0, 0, 1))

# ---- group: Construcciones
number_slider_8 = Slider(2, range=0..10)  # disabled
rdgis_8 = ReadGIS(PathToFile=panel, LayerToSelect=number_slider_8)  # -> CatchErrors, LatitudeOfGeometry, LongitudeOfGeometry, AltitudeOfGeometry, CullPattern; disabled
proj_13 = Projections(Latitude=rdgis_8.LatitudeOfGeometry, Longitude=rdgis_8.LongitudeOfGeometry)  # -> ProjectedPoints, Erros; disabled
pline_7 = PolyLine(Vertices=proj_13.ProjectedPoints, Closed=True)  # disabled

# ---- group: Construcciones / Extract Features
gisextr_6 = GISExtractor(PathToFile=panel, FieldToSelect=number_slider, LayerToSelect=number_slider_8)  # -> CatchErrors, NumberOfFeatures, Layers, Fields, OutputField, GeometryType; disabled
panel_14 = Panel(gisextr_6.OutputField)  # disabled

# ---- group: Construcciones / BBox
gisext_4 = GISExtents(PathToFile=panel, LayerToSelect=number_slider_8)  # -> CatchErrors, MinimumX, MinimumY, MaximumX, MaximumY
proj_14 = Projections(Latitude=gisext_4.MinimumX, Longitude=gisext_4.MinimumY)  # -> ProjectedPoints, Erros; disabled
proj_15 = Projections(Latitude=gisext_4.MaximumX, Longitude=gisext_4.MaximumY)  # -> ProjectedPoints, Erros; disabled
rec_2pt_3 = Rectangle2Pt(Plane=PlaneXY(0, 0, 0), PointA=proj_14.ProjectedPoints, PointB=proj_15.ProjectedPoints, Radius=0)  # -> Rectangle, Length; disabled
area_4 = Area(Geometry=rec_2pt_3.Rectangle)  # -> Area, Centroid; disabled
vec2pt_7 = Vector2Pt(PointA=area_4.Centroid, PointB=pt, Unitize=False)  # -> Vector, Length; disabled
move_10 = Move(Geometry=rec_2pt_3.Rectangle, Motion=vec2pt_7.Vector)  # -> Geometry, Transform; disabled
scale_9 = Scale(Geometry=move_10.Geometry, Center=pt, Factor=number_slider_2)  # -> Geometry, Transform; disabled

# ---- group: Vías / BBox
gisext_5 = GISExtents(PathToFile=panel, LayerToSelect=number_slider_8)  # -> CatchErrors, MinimumX, MinimumY, MaximumX, MaximumY
proj_16 = Projections(Latitude=gisext_5.MinimumX, Longitude=gisext_5.MinimumY)  # -> ProjectedPoints, Erros
proj_17 = Projections(Latitude=gisext_5.MaximumX, Longitude=gisext_5.MaximumY)  # -> ProjectedPoints, Erros
rec_2pt_4 = Rectangle2Pt(Plane=PlaneXY(0, 0, 0), PointA=proj_16.ProjectedPoints, PointB=proj_17.ProjectedPoints, Radius=0)  # -> Rectangle, Length
area_5 = Area(Geometry=rec_2pt_4.Rectangle)  # -> Area, Centroid

# ---- group: CenterY
subtraction = Subtraction(A=gisext_4.MaximumY, B=gisext_4.MinimumY)
multiplication_2 = Multiplication(A=subtraction, B=0.5)
addition = Addition(A=gisext_4.MinimumY, B=multiplication_2)
panel_15 = Panel(addition)

# ---- group: CenterX
subtraction_2 = Subtraction(A=gisext_4.MaximumX, B=gisext_4.MinimumX)
multiplication_3 = Multiplication(A=subtraction_2, B=0.5)
addition_2 = Addition(A=gisext_4.MinimumX, B=multiplication_3)
panel_16 = Panel(addition_2)

# ---- group: Construcciones (continued)
move_11 = Move(Geometry=pline_7, Motion=vec2pt_7.Vector)  # -> Geometry, Transform; disabled
scale_10 = Scale(Geometry=move_11.Geometry, Center=pt, Factor=number_slider_2)  # -> Geometry, Transform; disabled

# ---- group: Construcciones / Extrusiones
number_slider_9 = Slider(10000, range=0..10000)  # disabled
area_6 = Area(Geometry=scale_10.Geometry)  # -> Area, Centroid; disabled
expression_2 = Expression(x=flatten(area_6.Area), y=number_slider_9, Expression="If( x < y, True, False )")  # disabled
number_slider_10 = Slider(3, range=0..10)  # disabled
cull_3 = CullPattern(List=flatten(scale_10.Geometry), CullPattern=expression_2)  # disabled
boundary = BoundarySurfaces(Edges=cull_3, UseTasks=False)  # disabled
Z_3 = UnitZ(Factor=number_slider_10)  # disabled
extr = Extrude(Base=boundary, Direction=Z_3)  # disabled

# ---- group: Edificios (continued)
srf_cp_2 = SurfaceClosestPoint(Point=area_2.Centroid, Surface=srfgrid)  # -> Point, UVPoint, Distance
pdecon_4 = Deconstruct(Point=srf_cp_2.Point)  # -> XComponent, YComponent, ZComponent
pt_3 = ConstructPoint(XCoordinate=pdecon.XComponent, YCoordinate=pdecon.YComponent, ZCoordinate=pdecon_4.ZComponent)

# ----
vec2pt_8 = Vector2Pt(PointA=area_2.Centroid, PointB=pt_3, Unitize=False)  # -> Vector, Length
move_12 = Move(Geometry=pline, Motion=vec2pt_8.Vector)  # -> Geometry, Transform

# ---- group: Edificios (continued)
boundary_2 = BoundarySurfaces(Edges=move_12.Geometry)
extr_2 = Extrude(Base=simplify(boundary_2), Direction=simplify(graft(Z_2)))
